# Grasshopper definition 06_nDArray_to_mesh.gh (Grasshopper 1.0.7)
# plug-ins: HDMolaGH

number_slider = Slider(3, range=0..10)
c_script = CSharpScript(depth=number_slider, rows=number_slider, cols=number_slider)  # -> out, A, x, y, z; inputs depth: Int32, rows: Int32, cols: Int32
# ---------- c_script: C# ----------
    int[,,] array3D = new int[depth, rows, cols];

    for (int d = 0; d < depth; d++)
    {
      for (int r = 0; r < rows; r++)
      {
        for (int c = 0; c < cols; c++)
        {
          array3D[d, r, c] = (d + r + c) % 2; // Alternating 0 and 1
        }
      }
    }
    A = array3D;
    x = array3D.GetLength(0);
    y = array3D.GetLength(1);
    z = array3D.GetLength(2);
# ---------- end c_script ----------
array_to_molamesh = ArrayToMolaMesh(Array=c_script.A, NX=c_script.x, NY=c_script.y, NZ=c_script.z, Value=Slider(0, range=0..100))
mola_to_rhino = MolaToRhino(MolaMesh=array_to_molamesh, WithColor=Toggle(True))
