# Grasshopper definition BlockDesignJ.gh (Grasshopper 1.0.7)
# plug-ins: HDMolaGH, FalseStartToggle

pt = Point(<point referenced from the Rhino model>)
pt_2 = Point(<point referenced from the Rhino model>)
pt_3 = Point(<point referenced from the Rhino model>)
pt_4 = Point(<point referenced from the Rhino model>)
pdecon = Deconstruct(Point=pt)  # -> XComponent, YComponent, ZComponent
pdecon_2 = Deconstruct(Point=pt_2)  # -> XComponent, YComponent, ZComponent
pdecon_3 = Deconstruct(Point=pt_3)  # -> XComponent, YComponent, ZComponent
pdecon_4 = Deconstruct(Point=pt_4)  # -> XComponent, YComponent, ZComponent

# ---- group: input
number_slider = Slider(222, range=0..1000)
number_slider_2 = Slider(175, range=0..200)
quad = MolaQuad(
    X1=pdecon_4.XComponent,
    Y1=pdecon_4.YComponent,
    Z1=0,
    X2=pdecon_2.XComponent,
    Y2=pdecon_2.YComponent,
    Z2=0,
    X3=pdecon_3.XComponent,
    Y3=pdecon_3.YComponent,
    Z3=0,
    X4=pdecon.XComponent,
    Y4=pdecon.YComponent,
    Z4=0)

# ---- group: block design
number_slider_3 = Slider(0.6, range=0..1)
number_slider_4 = Slider(0.4, range=0..1)
relative = SubdivideRelative(
    MolaMesh=quad,
    StartDiriection=0,
    MinSplit1=number_slider_4,
    MaxSplit1=number_slider_4,
    MinSplit2=number_slider_3,
    MaxSplit2=number_slider_3,
    Iteration=2)

number_slider_5 = Slider(2, range=0..10)
grid = SubdivideGrid(MolaMesh=relative, U=number_slider_5, V=number_slider_5, Iteration=1)

analyze_mesh = AnalyzeMolaMesh(MolaMesh=grid)  # -> VerticeCount, FaceCount
random = Random(Range=Domain(0, 1), Number=analyze_mesh.FaceCount, Seed=Slider(6, range=0..10))
larger = LargerThan(FirstNumber=random, SecondNumber=0.3)  # -> LargerThan, OrEqualTo
split = MeshSplit(MolaMesh=grid, BooleanList=larger.OrEqualTo)  # -> MolaMesh1, MolaMesh2
grid_2 = SubdivideGrid(MolaMesh=split.MolaMesh1, U=2, V=1, Iteration=1)
join = MeshJoin(MolaMeshes=[split.MolaMesh2, grid_2])

# ---- group: further divide plots which are too long
face_proportion = AnalyzeFaceProportion(MolaMesh=join)
larger_2 = LargerThan(FirstNumber=face_proportion, SecondNumber=Slider(5.963, range=0..10))  # -> LargerThan, OrEqualTo
number_slider_6 = Slider(15, range=0..20)
split_2 = MeshSplit(MolaMesh=join, BooleanList=larger_2.LargerThan)  # -> MolaMesh1, MolaMesh2
linear_split_border = SubdivideLinearSplitBorder(MolaMesh=split_2.MolaMesh1, BorderWidth1=number_slider_6, BorderWidth2=number_slider_6, SplitDirection=0, Iteration=1)
join_2 = MeshJoin(MolaMeshes=[split_2.MolaMesh2, linear_split_border])

# ---- group: assign small plots to park
face_area = AnalyzeFaceArea(MolaMesh=join_2)
smaller = SmallerThan(FirstNumber=face_area, SecondNumber=Slider(442, range=0..500))  # -> SmallerThan, OrEqualTo
split_3 = MeshSplit(MolaMesh=join_2, BooleanList=smaller.OrEqualTo)  # -> MolaMesh1, MolaMesh2

# ---- group: road
number_slider_7 = Slider(-4, range=-10..5)
offset = SubdivideOffset(MolaMesh=split_3.MolaMesh2, Offset=number_slider_7, Iteration=1)
face_modulo = AnalyzeFaceModulo(MolaMesh=offset, Modulo=5, N=4)
split_4 = MeshSplit(MolaMesh=offset, BooleanList=face_modulo)  # -> MolaMesh1, MolaMesh2

offset_2 = SubdivideOffset(MolaMesh=split_3.MolaMesh1, Offset=number_slider_7, Iteration=1)
face_modulo_2 = AnalyzeFaceModulo(MolaMesh=offset_2, Modulo=5, N=4)
split_5 = MeshSplit(MolaMesh=offset_2, BooleanList=face_modulo_2)  # -> MolaMesh1, MolaMesh2

# ---- group: long plots for rectangular buildings, square plots for cylinder buildings
face_proportion_2 = AnalyzeFaceProportion(MolaMesh=split_4.MolaMesh1)
larger_3 = LargerThan(FirstNumber=face_proportion_2, SecondNumber=Slider(1.78, range=0..3))  # -> LargerThan, OrEqualTo
split_6 = MeshSplit(MolaMesh=split_4.MolaMesh1, BooleanList=larger_3.LargerThan)  # -> MolaMesh1, MolaMesh2

# ---- group: make rectangular buildings
analyze_mesh_2 = AnalyzeMolaMesh(MolaMesh=split_6.MolaMesh1)  # -> VerticeCount, FaceCount
random_2 = Random(Range="10 to 50", Number=analyze_mesh_2.FaceCount, Seed=Slider(1, range=0..10))
repeat = RepeatData(Data=Toggle(True), Length=analyze_mesh_2.FaceCount)
extrude_values = SubdivideExtrudeValues(MolaMesh=split_6.MolaMesh1, HeightValues=random_2, Cap=repeat, Iteration=1)

# ---- group: cylinder buildings
explode = MeshExplode(MolaMesh=split_6.MolaMesh2)
face_location = AnalyzeFaceLocation(MolaMesh=explode)
face_perimeter = AnalyzeFaceEdgePerimeter(MolaMesh=explode)
pdecon_5 = Deconstruct(Point=face_location)  # -> XComponent, YComponent, ZComponent
division = Division(A=face_perimeter, B=8)
circle = MolaCircle(X=pdecon_5.XComponent, Y=pdecon_5.YComponent, Z=pdecon_5.ZComponent, Radius=division, Segments=Slider(12, range=0..100))
lng = ListLength(List=explode)
random_3 = Random(Range="40 to 90", Number=lng, Seed=2)  # -> graft(Random)
extrude = SubdivideExtrude(MolaMesh=circle, Height=random_3, Cap=True, Iteration=1)
face_modulo_3 = AnalyzeFaceModulo(MolaMesh=extrude, Modulo=4, N=1)
split_7 = MeshSplit(MolaMesh=extrude, BooleanList=face_modulo_3)  # -> MolaMesh1, MolaMesh2
split_grid_abs = SubdivideSplitGridAbs(MolaMesh=split_7.MolaMesh1, USize=Slider(5, range=0..10), VSize=Slider(3, range=0..10), Iteration=1)
analyze_mesh_3 = AnalyzeMolaMesh(MolaMesh=split_grid_abs)  # -> VerticeCount, FaceCount
random_4 = Random(Range=Domain(0, 1), Number=analyze_mesh_3.FaceCount, Seed=2)
larger_4 = LargerThan(FirstNumber=random_4, SecondNumber=0.7)  # -> LargerThan, OrEqualTo
split_8 = MeshSplit(MolaMesh=split_grid_abs, BooleanList=larger_4.LargerThan)  # -> MolaMesh1, MolaMesh2
offset_face = SubdivideOffsetFace(MolaMesh=split_8.MolaMesh2, Offset=Slider(-6, range=-10..-3), CloseBorders=True, Iteration=1)
catmullclark = SubdivideCatmullClark(MolaMesh=offset_face, Iteration=1)  # -> flatten(MolaMesh)
extrude_tapered = SubdivideExtrudeTapered(MolaMesh=offset_face, Height=0, Fraction=0.2, Cap=True, Iteration=1)
face_modulo_4 = AnalyzeFaceModulo(MolaMesh=extrude_tapered, Modulo=5, N=4)
split_9 = MeshSplit(MolaMesh=extrude_tapered, BooleanList=face_modulo_4)  # -> MolaMesh1, MolaMesh2
offset_face_2 = SubdivideOffsetFace(MolaMesh=split_9.MolaMesh2, Offset=Slider(-0.4, range=-1..0), CloseBorders=True, Iteration=1)

# ----
toggle = FalseStartToggle(False)

# ---- group: road
join_3 = MeshJoin(MolaMeshes=[split_4.MolaMesh2, split_5.MolaMesh2])
color = ColorMesh(MolaMesh=join_3, Mode=0, SingleColor=ColourSwatch(SwatchColor=RGB(0, 0, 0)), ColorList=RGB(255, 255, 255), ValueList=0)
to_rhino = MolaToRhino(MolaMesh=color, WithColor=toggle)

# ---- group: white facade
join_4 = MeshJoin(MolaMeshes=offset_face_2)  # -> flatten(MolaMesh)
color_2 = ColorMesh(
    MolaMesh=join_4,
    Mode=0,
    SingleColor=ColourSwatch(SwatchColor=RGB(255, 255, 255)),
    ColorList=RGB(255, 255, 255),
    ValueList=0)
to_rhino_2 = MolaToRhino(MolaMesh=color_2, WithColor=toggle)

# ---- group: short buildings have pitched roof
face_modulo_5 = AnalyzeFaceModulo(MolaMesh=extrude_values, Modulo=5, N=4)
split_10 = MeshSplit(MolaMesh=extrude_values, BooleanList=face_modulo_5)  # -> MolaMesh1, MolaMesh2
panel = Panel("""4
4
4
4""")
face_location_2 = AnalyzeFaceLocation(MolaMesh=split_10.MolaMesh1)
pdecon_6 = Deconstruct(Point=face_location_2)  # -> XComponent, YComponent, ZComponent
smaller_2 = SmallerThan(FirstNumber=pdecon_6.ZComponent, SecondNumber=15)  # -> SmallerThan, OrEqualTo
stack = StackData(Data=smaller_2.SmallerThan, Stack=panel)
split_11 = MeshSplit(MolaMesh=split_10.MolaMesh1, BooleanList=smaller_2.SmallerThan)  # -> MolaMesh1, MolaMesh2
split_12 = MeshSplit(MolaMesh=split_10.MolaMesh2, BooleanList=stack)  # -> MolaMesh1, MolaMesh2
split_roof = SubdivideSplitRoof(MolaMesh=split_11.MolaMesh1, Height=Slider(8, range=0..10), Iteration=1)
grid_3 = SubdivideGrid(MolaMesh=split_12.MolaMesh1, U=Slider(14, range=0..20), V=Slider(5, range=0..10), Iteration=1)
analyze_mesh_4 = AnalyzeMolaMesh(MolaMesh=grid_3)  # -> VerticeCount, FaceCount
random_5 = Random(Range=Domain(0, 1), Number=analyze_mesh_4.FaceCount, Seed=2)
larger_5 = LargerThan(FirstNumber=random_5, SecondNumber=Slider(0.15, range=0..1))  # -> LargerThan, OrEqualTo
split_13 = MeshSplit(MolaMesh=grid_3, BooleanList=larger_5.LargerThan)  # -> MolaMesh1, MolaMesh2

# ---- group: park
join_5 = MeshJoin(MolaMeshes=[split_11.MolaMesh2, split_6.MolaMesh2, split_5.MolaMesh1])
color_3 = ColorMesh(MolaMesh=join_5, Mode=0, SingleColor=ColourSwatch(SwatchColor=RGB(8, 250, 0)), ColorList=RGB(255, 255, 255), ValueList=0)
to_rhino_3 = MolaToRhino(MolaMesh=color_3, WithColor=toggle)

# ---- group: grey facade
join_6 = MeshJoin(MolaMeshes=[split_roof, split_13.MolaMesh1])
color_4 = ColorMesh(
    MolaMesh=join_6,
    Mode=0,
    SingleColor=ColourSwatch(SwatchColor=RGB(150, 150, 149)),
    ColorList=RGB(255, 255, 255),
    ValueList=0)
to_rhino_4 = MolaToRhino(MolaMesh=color_4, WithColor=toggle)

# ---- group: taller buildings have meta frames
number_slider_8 = Slider(3, range=0..10)
grid_4 = SubdivideGrid(MolaMesh=split_12.MolaMesh2, U=number_slider_8, V=number_slider_8, Iteration=1)
extrude_tapered_2 = SubdivideExtrudeTapered(MolaMesh=grid_4, Height=0, Fraction=0.15, Cap=True, Iteration=1)
face_modulo_6 = AnalyzeFaceModulo(MolaMesh=extrude_tapered_2, Modulo=5, N=4)
split_14 = MeshSplit(MolaMesh=extrude_tapered_2, BooleanList=face_modulo_6)  # -> MolaMesh1, MolaMesh2
offset_face_3 = SubdivideOffsetFace(MolaMesh=split_14.MolaMesh2, Offset=0.2, CloseBorders=True, Iteration=1)
analyze_mesh_5 = AnalyzeMolaMesh(MolaMesh=split_14.MolaMesh1)  # -> VerticeCount, FaceCount
random_6 = Random(Range=Domain(0, 1), Number=analyze_mesh_5.FaceCount, Seed=2)
larger_6 = LargerThan(FirstNumber=random_6, SecondNumber=Slider(0.6, range=0..1))  # -> LargerThan, OrEqualTo
split_15 = MeshSplit(MolaMesh=split_14.MolaMesh1, BooleanList=larger_6.LargerThan)  # -> MolaMesh1, MolaMesh2
extrude_2 = SubdivideExtrude(MolaMesh=split_15.MolaMesh1, Height=Slider(-9, range=-10..-9), Cap=True, Iteration=1)
join_7 = MeshJoin(MolaMeshes=[split_15.MolaMesh1, extrude_2])
split_grid_abs_2 = SubdivideSplitGridAbs(MolaMesh=join_7, USize=Slider(2, range=0..10), VSize=Slider(4, range=0..10), Iteration=1)
extrude_tapered_3 = SubdivideExtrudeTapered(MolaMesh=split_grid_abs_2, Height=0, Fraction=0.2, Cap=True, Iteration=1)
face_modulo_7 = AnalyzeFaceModulo(MolaMesh=extrude_tapered_3, Modulo=5, N=4)
split_16 = MeshSplit(MolaMesh=extrude_tapered_3, BooleanList=face_modulo_7)  # -> MolaMesh1, MolaMesh2

# ---- group: glass
join_8 = MeshJoin(MolaMeshes=[split_9.MolaMesh1, split_13.MolaMesh2, split_16.MolaMesh1])
color_5 = ColorMesh(
    MolaMesh=join_8,
    Mode=0,
    SingleColor=ColourSwatch(SwatchColor=RGB(32, 87, 145)),
    ColorList=RGB(255, 255, 255),
    ValueList=0)
to_rhino_5 = MolaToRhino(MolaMesh=color_5, WithColor=toggle)

# ---- group: metal facade
join_9 = MeshJoin(MolaMeshes=[split_16.MolaMesh2, offset_face_3])
color_6 = ColorMesh(
    MolaMesh=join_9,
    Mode=0,
    SingleColor=ColourSwatch(SwatchColor=RGB(212, 166, 0)),
    ColorList=RGB(255, 255, 255),
    ValueList=0)
to_rhino_6 = MolaToRhino(MolaMesh=color_6, WithColor=toggle)
